# Grasshopper definition 16_robot_example.ghx (Grasshopper 1.0.7)

connect = BooleanToggle(False)
load = BooleanToggle(False)
ros_connect = GhPythonScript(connect=connect)  # -> ros_client, is_connected
# ---------- ros_connect: Python ----------
import Grasshopper
import System
from ghpythonlib.componentbase import executingcomponent as component
from scriptcontext import sticky as st

from compas_fab.backends import RosClient
from compas_fab.ghpython.components import create_id


class ROSConnect(component):
    def SetUpParam(self, p, name, nickname, description):
        p.Name = name
        p.NickName = nickname
        p.Description = description
        p.Optional = True

    def RegisterInputParams(self, pManager):

        p = Grasshopper.Kernel.Parameters.Param_String()
        self.SetUpParam(p, "ip", "ip", "The ip address of ROS master. Defaults to 127.0.0.1")
        p.Access = Grasshopper.Kernel.GH_ParamAccess.item
        self.Params.Input.Add(p)

        p = Grasshopper.Kernel.Parameters.Param_Integer()
        self.SetUpParam(p, "port", "port", "The port of ROS master. Defaults to 9090.")
        p.Access = Grasshopper.Kernel.GH_ParamAccess.item
        self.Params.Input.Add(p)

        p = Grasshopper.Kernel.Parameters.Param_Boolean()
        self.SetUpParam(p, "connect", "connect", "If `True`, connect to ROS. If `False`, disconnect from ROS. Defaults to False.")
        p.Access = Grasshopper.Kernel.GH_ParamAccess.item
        self.Params.Input.Add(p)

    def RegisterOutputParams(self, pManager):
        p = Grasshopper.Kernel.Parameters.Param_GenericObject()
        self.SetUpParam(p, "ros_client", "ros_client", "The ROS client.")
        self.Params.Output.Add(p)

        p = Grasshopper.Kernel.Parameters.Param_Boolean()
        self.SetUpParam(p, "is_connected", "is_connected", "`True` if connection established.")
        self.Params.Output.Add(p)

    def SolveInstance(self, DA):
        p0 = self.marshal.GetInput(DA, 0)
        p1 = self.marshal.GetInput(DA, 1)
        p2 = self.marshal.GetInput(DA, 2)
        result = self.RunScript(p0, p1, p2)

        if result is not None:
            if not hasattr(result, '__getitem__'):
                self.marshal.SetOutput(result, DA, 0, True)
            else:
                self.marshal.SetOutput(result[0], DA, 0, True)
                self.marshal.SetOutput(result[1], DA, 1, True)

    def RunScript(self, ip, port, connect):
        ros_client = None

        ip = ip or '127.0.0.1'
        port = port or 9090

        key = create_id(self, 'ros_client')
        ros_client = st.get(key, None)

        if ros_client:
            st[key].close()
        if connect:
            st[key] = RosClient(ip, port)
            st[key].run(5)

        ros_client = st.get(key, None)
        is_connected = ros_client.is_connected if ros_client else False
        return (ros_client, is_connected)
# ---------- end ros_connect ----------
load_robot = GhPythonScript(ros_client=ros_connect.ros_client, load=load)  # -> robot
# ---------- load_robot: Python ----------
import Grasshopper
import System
from ghpythonlib.componentbase import executingcomponent as component
from scriptcontext import sticky as st

import compas
from compas_fab.ghpython.components import create_id
from compas_fab.ghpython.components.icons import ros_robot_icon
from compas_ghpython.artists import RobotModelArtist


class ROSRobot(component):
    def SetUpParam(self, p, name, nickname, description):
        p.Name = name
        p.NickName = nickname
        p.Description = description
        p.Optional = True

    def RegisterInputParams(self, pManager):
        p = Grasshopper.Kernel.Parameters.Param_GenericObject()
        self.SetUpParam(p, "ros_client", "ros_client", "The ROS client.")
        p.Access = Grasshopper.Kernel.GH_ParamAccess.item
        self.Params.Input.Add(p)

        p = Grasshopper.Kernel.Parameters.Param_Boolean()
        self.SetUpParam(p, "load", "load", "If `True`, loads the robot from ROS. Defaults to False.")
        p.Access = Grasshopper.Kernel.GH_ParamAccess.item
        self.Params.Input.Add(p)

    def RegisterOutputParams(self, pManager):
        p = Grasshopper.Kernel.Parameters.Param_GenericObject()
        self.SetUpParam(p, "robot", "robot", "The robot.")
        self.Params.Output.Add(p)

    def SolveInstance(self, DA):
        p0 = self.marshal.GetInput(DA, 0)
        p1 = self.marshal.GetInput(DA, 1)
        result = self.RunScript(p0, p1)

        if result is not None:
            self.marshal.SetOutput(result, DA, 0, True)

    def get_Internal_Icon_24x24(self):
        return ros_robot_icon

    def RunScript(self, ros_client, load):
        self.Message = "Loading..."
        compas.PRECISION = '12f'

        key = create_id(self, 'robot')

        if ros_client and ros_client.is_connected and load:
            # Load URDF from ROS
            robot = ros_client.load_robot(load_geometry=True)
            robot.artist = RobotModelArtist(robot.model)
            self.Message = "{} loaded".format(robot.name)
            st[key] = robot
        else:
            if st.get(key):
                self.Message = "{} loaded".format(st.get(key).name)
            else:
                self.Message = "No robot"

        robot = st.get(key, None)
        if robot:  # client sometimes need to be restarted, without needing to reload geometry
            robot.client = ros_client
        return robot
# ---------- end load_robot ----------

# ----
# Load Robot from Local
py = GhPythonScript()  # -> urdf_source
# ---------- py: Python ----------
import os
import sys

filepath = ghenv.Component.Attributes.Owner.OnPingDocument().FilePath
path = os.path.abspath(os.path.join(filepath, "..", ".."))
print(path)

urdf_source = os.path.abspath(os.path.join(path, "robot_description"))
# ---------- end py ----------
panel = Panel(py)
robot_name = ValueList({"ur10_2m"}, selected="ur10_2m")
path = PythonScript(path=panel, robot_name=robot_name)  # -> urdf_source
# ---------- path: Python ----------
import os

urdf_source = os.path.join(os.path.abspath(path), robot_name)

assert(os.path.isdir(urdf_source))
# ---------- end path ----------
load_2 = BooleanToggle(True)
units = ValueList({"m": 1, "mm": 1000}, selected="mm")
robot = PythonScript(urdf_source=path, ros_client=ros_connect.ros_client, scale_factor=units, load=load_2)  # -> out, robot
# ---------- robot: Python ----------
import os
from scriptcontext import sticky as st
import compas


from compas.robots import RobotModel
from compas.robots import LocalPackageMeshLoader
from compas_fab.ghpython import RobotArtist
from compas_fab.robots import RobotSemantics as RobotSemantics

from compas_fab.robots import Robot as Robot
from compas_fab.backends import RosClient

# Set high precision to import meshes defined in meters
compas.PRECISION = '12f'

# store data in component
guid = str(ghenv.Component.InstanceGuid)
robot_key = "robot_" + guid


if robot_key not in st:
    st[robot_key] = None


if ros_client and ros_client.is_connected and load == True:
    
    model = RobotModel.from_urdf_file(os.path.join(urdf_source, 'robot_description.urdf'))
    model.load_geometry(LocalPackageMeshLoader(urdf_source, 'robot_description'))
    semantics = RobotSemantics.from_srdf_file(os.path.join(urdf_source, 'robot_description.srdf'), model)
    artist = RobotArtist(model)
    robot = Robot(model, artist, semantics)
    
    robot.scale(scale_factor)
    st[robot_key] = robot

robot = st[robot_key]

if robot:
    robot.client = ros_client
# ---------- end robot ----------
info = PythonScript(robot=robot.robot)  # -> out, main_group_name
# ---------- info: Python ----------
if robot:
    robot.info()
    main_group_name = robot.main_group_name
# ---------- end info ----------
main_planning_group = Text(info.main_group_name)
panel_2 = Panel(info.out)

visualize = GhPythonScript(robot=robot.robot)  # -> visual, frames
# ---------- visualize: Python ----------
import Grasshopper
import System
from ghpythonlib.componentbase import executingcomponent as component

from compas.geometry import Frame
from compas.geometry import Transformation
from compas_ghpython.artists import MeshArtist
#from compas_fab.ghpython.components.icons import robot_visualize_icon
from compas_ghpython import draw_frame

class RobotVisualize(component):
    def SetUpParam(self, p, name, nickname, description):
        p.Name = name
        p.NickName = nickname
        p.Description = description
        p.Optional = True

    def RegisterInputParams(self, pManager):
        p = Grasshopper.Kernel.Parameters.Param_GenericObject()
        self.SetUpParam(p, "robot", "robot", "The robot.")
        p.Access = Grasshopper.Kernel.GH_ParamAccess.item
        self.Params.Input.Add(p)

        p = Grasshopper.Kernel.Parameters.Param_String()
        self.SetUpParam(p, "group", "group", "The planning group used for end-effector and base visualization.")
        p.Access = Grasshopper.Kernel.GH_ParamAccess.item
        self.Params.Input.Add(p)

        p = Grasshopper.Kernel.Parameters.Param_GenericObject()
        self.SetUpParam(p, "configuration", "configuration", "The robot's full configuration.")
        p.Access = Grasshopper.Kernel.GH_ParamAccess.item
        self.Params.Input.Add(p)

    def RegisterOutputParams(self, pManager):

        p = Grasshopper.Kernel.Parameters.Param_GenericObject()
        self.SetUpParam(p, "visual", "visual", "The robot's visual meshes.")
        self.Params.Output.Add(p)

        p = Grasshopper.Kernel.Parameters.Param_GenericObject()
        self.SetUpParam(p, "frames", "frames", "The robot's joint frames.")
        self.Params.Output.Add(p)

    def SolveInstance(self, DA):
        p0 = self.marshal.GetInput(DA, 0)
        p1 = self.marshal.GetInput(DA, 1)
        p2 = self.marshal.GetInput(DA, 2)
        result = self.RunScript(p0, p1, p2)

        if result is not None:
            if not hasattr(result, '__getitem__'):
                self.marshal.SetOutput(result, DA, 0, True)
            else:
                self.marshal.SetOutput(result[0], DA, 0, True)
                self.marshal.SetOutput(result[1], DA, 1, True)

    def get_Internal_Icon_24x24(self):
        return robot_visualize_icon

    def RunScript(self, robot, group, configuration):

        visual = None
        frames = None

        if robot:
            configuration = configuration or robot.zero_configuration()

            robot.update(configuration, visual=True, collision=False)
            frames = [draw_frame(f) for f in robot.transformed_frames(configuration, group)]

            visual = robot.artist.draw_visual()

        return (visual, frames)
# ---------- end visualize ----------
